# Grasshopper definition GH_voxel_generation.gh (Grasshopper 1.0.8)
# plug-ins: Heteroptera, Firefly_X, Telepathy, NGon_RH8

# ---- group: Text - Inter SemiBold
F = Font(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)
as_text = AnnotationTextSettings(
    Font=F,
    TextHeight=Slider(1.5, range=0..100),
    MaskColour=ColourSwatch(SwatchColor=RGB(0, 0, 0)),
    HorizontalAlignment="0",
    VerticalAlignment="0")  # -> TextSettings, Font, TextHeight, TextGap, Mask, MaskColour, MaskMargins, MaskFrame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
annotation_style = AnnotationStyle(Name="Annotation", TextSettings=as_text.TextSettings)  # -> AnnotationStyle, Name, ModelScale, TextSettings, DimensionSettings, ArrowSettings, UnitsSettings, LeaderSettings, ToleranceSettings
style = ModelAnnotationStyle(annotation_style.AnnotationStyle)
set_annotation_style = RemoteSender(style)

# ---- group: Text
geo = Geometry([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])

# ----
# TEXT SETTINGS
geo_2 = Geometry(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)

# ----
# CLAY BLOCK DIMENSIONS
length = Slider(300, range=0..1000)
width = Slider(150, range=0..1000)
height = Slider(30, range=0..100)
rectangle = Rectangle(Plane=PlaneXY(0, 0, 0), XSize=length, YSize=width, Radius=0)  # -> Rectangle, Length
neg = Negative(Value=height)
srf = Surface(rectangle.Rectangle)
Z = UnitZ(Factor=neg)
extr = Extrude(Base=srf, Direction=Z)

# ----
# Locate the voxel unit into BBOX's corner
# Be careful with small numbers!
panel = Panel("0")

# ---- group: Voxel Density
number_slider = Slider(5, range=5..25)

# ---- group: Resolution
# LOAD HEIGHT_MAP FILE FROM LOCAL DIRECTORY
# LARGER NUMBER MORE RESOLUTION
# BE CAREFUL!
number_slider_2 = Slider(25, range=0..200)
dim = Dimensions(Surface=srf)  # -> UDimension, VDimension
division = Division(A=dim.VDimension, B=dim.UDimension)
multiplication = Multiplication(A=division, B=number_slider_2)

# ----
img = ImportImage(
    File="G:\Otros ordenadores\Mi portátil\A\MRAC - IAAC\Term III\Hardware III\images.jpg",
    Rectangle=rectangle.Rectangle,
    XSamples=number_slider_2,
    YSamples=multiplication)
demesh = DeconstructMesh(Mesh=img)  # -> Vertices, Faces, Colours, Normals
ahsl = SplitAHSL(Colour=demesh.Colours)  # -> Alpha, Hue, Saturation, Luminance
panel_2 = Panel(ahsl.Luminance)
dots = DotDisplay(Point=demesh.Vertices, Colour=demesh.Colours, Size=1)
set_annotation_style_2 = RemoteReceiver(set_annotation_style)
neg_2 = Negative(Value=height)
neg_3 = Negative(Value=Slider(3, range=0..100))
bnd = Bounds(Numbers=panel_2)
dom = ConstructDomain(DomainStart=0, DomainEnd=neg_2)
Y = UnitY(Factor=neg_3)
remap = RemapNumbers(Value=panel_2, Source=bnd, Target=dom)  # -> Mapped, Clipped
move = Move(Geometry=demesh.Vertices, Motion=Y)  # -> Geometry, Transform
text = TextEntity(Plane=graft(move.Geometry), Text=graft(ahsl.Luminance), Style=set_annotation_style_2)  # -> TextEntity, Plane, Text, Style
Z_2 = UnitZ(Factor=remap.Mapped)
move_2 = Move(Geometry=demesh.Vertices, Motion=Z_2)  # -> Geometry, Transform
conmesh = ConstructMesh(Vertices=move_2.Geometry, Faces=demesh.Faces)
medges = MeshEdges(Mesh=conmesh)  # -> NakedEdges, InteriorEdges, NonManifoldEdges
geo_mesh_from_height_map = RemoteSender(conmesh)
geo_mesh_from_height_map_2 = RemoteReceiver(geo_mesh_from_height_map)
mesh = Mesh(geo_mesh_from_height_map_2)
bbox = BoundingBox(Content=mesh, Plane=PlaneXY(0, 0, 0))  # -> Box, Box_2
debrep = DeconstructBrep(Brep=bbox.Box)  # -> Faces, Edges, Vertices
box = EvaluateBox(Box=bbox.Box, UParameter=panel, VParameter=panel, WParameter=panel)  # -> Plane, Point, Include
item = ListItem(List=debrep.Edges, Index=0, Wrap=True)  # -> Item1, Item, Item1_2

# ---- group: Z
num = Number(item.Item1)

# ---- group: X
num_2 = Number(item.Item)

# ----
Y_2 = Number(item.Item1_2)
division_2 = Division(A=num, B=number_slider)
division_3 = Division(A=num_2, B=number_slider)
division_4 = Division(A=Y_2, B=number_slider)
box_2 = DomainBox(Base=box.Plane, X=number_slider, Y=number_slider, Z=number_slider)
mesh_2 = Mesh(box_2)
arrbox = BoxArray(Geometry=mesh_2, Cell=mesh_2, XCount=division_3, YCount=division_4, ZCount=division_2)  # -> Geometry, Transform

Y_3 = UnitY(Factor=Slider(200, range=0..1000))
move_3 = Move(Geometry=img, Motion=Y_3)  # -> Geometry, Transform
bbox_2 = BoundingBox(Content=arrbox.Geometry, Plane=PlaneXY(0, 0, 0), UnionBox=True)  # -> Box, Box_2
area = Area(Geometry=move_3.Geometry)  # -> Area, Centroid
area_2 = Area(Geometry=bbox_2.Box)  # -> Area, Centroid
X = UnitX(Factor=Slider(200, range=0..1000))
project = Project(Geometry=area_2.Centroid, Plane=PlaneXY(0, 0, 0))  # -> Geometry, Transform
move_4 = Move(Geometry=area.Centroid, Motion=X)  # -> Geometry, Transform
move_5 = Move(Geometry=project.Geometry, Motion=X)  # -> Geometry, Transform
set_annotation_style_3 = RemoteReceiver(set_annotation_style)
concat = Concatenate(FragmentA="height_map", FragmentC="target_design")
concat_2 = Concatenate(FragmentA="voxel_projection", FragmentC="current_design")
text_2 = TextEntity(Plane=graft([move_4.Geometry, move_5.Geometry]), Text=graft([concat, concat_2]), Style=set_annotation_style_3)  # -> TextEntity, Plane, Text, Style

colom = CollisionOneMany(Collider=arrbox.Geometry, Obstacles=mesh)  # -> Collision, Index
dispatch = Dispatch(List=arrbox.Geometry, DispatchPattern=colom.Collision)  # -> ListA, ListB
mesh_3 = Mesh(dispatch.ListB)

trigger = Trigger(Interval=100, TimerInterval=100, Target=counter)
dom_2 = ConstructDomain(DomainStart=0, DomainEnd=1)
counter = Counter(CountDirection=True, Step=Slider(0.01, range=0..0.01), StartStop=True, Reset=Button(), OptionalCounterDomain=dom_2)
lng = ListLength(List=mesh_3)
multiplication_2 = Multiplication(A=lng, B=counter)
rev = ReverseList(List=mesh_3)
dom_3 = ConstructDomain(DomainStart=lng, DomainEnd=multiplication_2)
subset = SubList(List=rev, Domain=dom_3, Wrap=True)  # -> List, Index
cull_i = CullIndex(List=subset.List, Indices="0", Wrap=True)

# ----
# TARGET TOPOGRAPHY
# MATERIAL TO REMOVE
area_3 = Area(Geometry=dispatch.ListA)  # -> Area, Centroid
pdecon = Deconstruct(Point=area_3.Centroid)  # -> XComponent, YComponent, ZComponent
extremes = MinMax(Number=pdecon.ZComponent)  # -> Minimum, Maximum
gradient = Gradient(
    LowerLimit=extremes.Minimum,
    UpperLimit=extremes.Maximum,
    Parameter=pdecon.ZComponent,
    stops=[0: RGB(0, 128, 0), 0.5: RGB(255, 255, 0), 1: RGB(255, 0, 0)])
preview = CustomPreview(Geometry=dispatch.ListA, Material=gradient)

preview_2 = CustomPreview(Geometry=conmesh, Material=ColourSwatch(SwatchColor=RGBA(181, 181, 181, 150)))
number_slider_3 = Slider(200, range=0..1000)  # disabled
pt = ConstructPoint(XCoordinate=0, YCoordinate=0, ZCoordinate=0)  # disabled
series = Series(Start=0, Step=number_slider_3, Count=10)  # disabled
Y_4 = UnitY(Factor=1)  # disabled
amp = Amplitude(Vector=Y_4, Amplitude=series)  # disabled
move_6 = Move(Geometry=pt, Motion=amp)  # -> Geometry, Transform; disabled
merge = Merge(Data1=flatten(extr), Data2=flatten(img), Data3=flatten(conmesh))  # -> graft(Result); disabled
bbox_3 = BoundingBox(Content=merge, Plane=PlaneXY(0, 0, 0))  # -> Box, Box_2; disabled
lng_2 = ListLength(List=flatten(merge))  # disabled
panel_3 = Panel("0")  # disabled
split = SplitList(List=move_6.Geometry, Index=lng_2)  # -> ListA, ListB; disabled
box_3 = EvaluateBox(Box=bbox_3.Box, UParameter=0.5, VParameter=0.5, WParameter=panel_3)  # -> Plane, Point, Include; disabled
orient = Orient(Geometry=merge, Source=box_3.Plane, Target=graft(split.ListA))  # -> simplify(Geometry), Transform; disabled
bang = ExplodeTree(Data=orient.Geometry)  # -> Branch0, Branch1, Branch2, Branch3; disabled
mesh_4 = Mesh(bang.Branch1)  # disabled
ungroup = Ungroup(Group=bang.Branch3)  # disabled
meshedges = MeshEdges(Mesh=ungroup)  # -> AllE, NakedE; disabled
swatch = ColourSwatch(SwatchColor=RGBA(0, 17, 255, 25))  # disabled
swatch_2 = ColourSwatch(SwatchColor=RGBA(138, 138, 138, 75))  # disabled

# ---- group: FLATTEN THIS VOXEL - VOXEL TO BITMAP
area_4 = Area(Geometry=ungroup)  # -> Area, Centroid; disabled
pdecon_2 = Deconstruct(Point=area_4.Centroid)  # -> XComponent, YComponent, ZComponent; disabled
extremes_2 = MinMax(Number=pdecon_2.ZComponent)  # -> Minimum, Maximum; disabled
gradient_2 = Gradient(
    LowerLimit=extremes_2.Minimum,
    UpperLimit=extremes_2.Maximum,
    Parameter=pdecon_2.ZComponent,
    stops=[0: RGB(0, 128, 0), 0.5: RGB(255, 255, 0), 1: RGB(255, 0, 0)])  # disabled
preview_3 = CustomPreview(Geometry=ungroup, Material=gradient_2)  # disabled

# ----
bbox_4 = BoundingBox(Content=bang.Branch2, Plane=PlaneXY(0, 0, 0))  # -> Box, Box_2; disabled
debrep_2 = DeconstructBrep(Brep=bbox_4.Box)  # -> Faces, Edges, Vertices; disabled
crv = Curve(debrep_2.Edges)  # disabled
preview_4 = CustomPreview(Geometry=[bang.Branch2, bang.Branch0], Material=swatch)  # disabled
preview_5 = CustomPreview(Geometry=debrep_2.Faces, Material=swatch_2)  # disabled
