# Grasshopper definition interface.gh (Grasshopper 1.0.8)

# ---- group: CC - Session State Reader
# CC — Session State Reader
# Reads the Clay Create session state from gh_state.json
# Outputs:
# - block_index: active block (0-based), -1 if none
# - cols / rows: grid dimensions
# - active: True if a block is currently being sculpted
# - sculptor: name of the active participant
# → Connect block_index to the pattern generation script
# CC — Grid Visualizer
# Visualizes the Clay Create block grid in Rhino.
# Updates in real time from the web interface.
# - Active block highlighted as [ACTIVE]
# - Connect block_index to the pattern generation script
trigger = Trigger(Interval=200, TimerInterval=200, Target=python_3_script)
python_3_script = Python3Script(enabled=Toggle(True))  # -> cols, rows, active, sculptor, status, bi, flatten(done)
# ---------- python_3_script: Python ----------
import json
import os
import time

FILE_PATH = r"C:\Users\xioma\MRAC\HRC-W31\clay_create\clay_create\gh_state.json"

block_index = -1
cols        = 3
rows        = 3
active      = False
sculptor    = ""
done_list   = []
status      = "waiting..."

if enabled:
    try:
        if os.path.exists(FILE_PATH):
            with open(FILE_PATH, "r") as f:
                content = f.read()

            payload     = json.loads(content)
            s           = payload.get("state", payload)
            cols        = int(s.get("cols", 3))
            rows        = int(s.get("rows", 3))
            bi_val      = s.get("active_block", None)
            block_index = int(bi_val) if bi_val is not None else -1
            active      = block_index >= 0
            blocks      = s.get("blocks", [])

            if active and block_index < len(blocks):
                sculptor = blocks[block_index].get("sculptor", "")

            done_list = [int(b.get("index", -1)) for b in blocks if b.get("status") == "done"]

            status = "B{} - {} | done={}".format(block_index + 1, sculptor, done_list)
        else:
            status = "File not found"
    except Exception as e:
        status = "Error: {}".format(str(e))
else:
    status = "Receiver disabled."

# ── OUTPUTS ───────────────────────────────────────────────────────────────────
bi     = block_index
cols   = cols
rows   = rows
active = active
sculptor = sculptor
done   = done_list
status = status
dn = str(done_list)

dn0 = done_list[0] if len(done_list) > 0 else -1
dn1 = done_list[1] if len(done_list) > 1 else -1
dn2 = done_list[2] if len(done_list) > 2 else -1
dn3 = done_list[3] if len(done_list) > 3 else -1
dn4 = done_list[4] if len(done_list) > 4 else -1
dn5 = done_list[5] if len(done_list) > 5 else -1
dn6 = done_list[6] if len(done_list) > 6 else -1
dn7 = done_list[7] if len(done_list) > 7 else -1
dn8 = done_list[8] if len(done_list) > 8 else -1
# ---------- end python_3_script ----------
panel = Panel(python_3_script.status)

# ----
panel_2 = Panel(python_3_script.done)
panel_3 = Panel(python_3_script.bi)

# ---- group: CC - Grid Visualizer
python_3_script_2 = Python3Script(
    cols=python_3_script.cols,
    rows=python_3_script.rows,
    block_index=python_3_script.bi,
    done_list=flatten(python_3_script.done),
    cell_size=Slider(150, range=0..1000))  # -> out, rects, colors, texts, srfs, active, inactive, done_surfaces, debug
# ---------- python_3_script_2: Python ----------
import Rhino.Geometry as rg
import System.Drawing as sd
import json
import os

try: cols = int(cols)
except: cols = 3
try: rows = int(rows)
except: rows = 3
try: block_index = int(block_index)
except: block_index = -1
try: cell_size = float(cell_size)
except: cell_size = 150.0

done_list = []
try:
    FILE_PATH = r"C:\Users\xioma\MRAC\HRC-W31\clay_create\clay_create\gh_state.json"
    if os.path.exists(FILE_PATH):
        with open(FILE_PATH, "r") as f:
            payload = json.load(f)
        s = payload.get("state", payload)
        blocks = s.get("blocks", [])
        done_list = [int(b.get("index", -1)) for b in blocks if b.get("status") == "done"]
except:
    done_list = []

COL_PENDING = sd.Color.FromArgb(140, 155, 150)
COL_ACTIVE  = sd.Color.FromArgb(29,  158, 117)
COL_DONE    = sd.Color.FromArgb(80,  100,  90)

rects_out  = []
colors_out = []
texts_out  = []
surfaces   = []

for i in range(cols * rows):
    col_idx = i % cols
    row_idx = i // cols

    x0 = col_idx * cell_size
    y0 = (rows - row_idx) * cell_size

    pt   = rg.Point3d(x0, y0, 0)
    pl   = rg.Plane(pt, rg.Vector3d.ZAxis)
    rect = rg.Rectangle3d(pl, cell_size * 0.95, cell_size * 0.95)
    rects_out.append(rect)

    crv  = rect.ToNurbsCurve()
    brep = rg.Brep.CreatePlanarBreps(crv, 0.001)
    if brep:
        surfaces.append(brep[0])
    else:
        surfaces.append(None)

    if i == block_index:
        colors_out.append(COL_ACTIVE)
        texts_out.append("B{} [ACTIVE]".format(i + 1))
    elif i in done_list:
        colors_out.append(COL_DONE)
        texts_out.append("B{} [DONE]".format(i + 1))
    else:
        colors_out.append(COL_PENDING)
        texts_out.append("B{}".format(i + 1))

total_w  = cols * cell_size
total_h  = rows * cell_size
base_pl  = rg.Plane(rg.Point3d(0, 0, 0), rg.Vector3d.ZAxis)
boundary = rg.Rectangle3d(base_pl, total_w, total_h)

active_srf   = None
inactive_srf = []
done_srf     = []

for idx, srf in enumerate(surfaces):
    if srf is None:
        continue
    col_idx2  = idx % cols
    row_idx2  = idx // cols
    visual_i2 = row_idx2 * cols + col_idx2

    if visual_i2 == block_index:
        active_srf = srf
    elif visual_i2 in done_list:
        done_srf.append(srf)
    else:
        inactive_srf.append(srf)

out           = boundary
rects         = rects_out
colors        = colors_out
texts         = texts_out
srfs          = surfaces
active        = active_srf
inactive      = inactive_srf
done_surfaces = done_srf
# ---------- end python_3_script_2 ----------
custom_preview = CustomPreview(Geometry=python_3_script_2.rects, Material=python_3_script_2.colors)
area = Area(Geometry=python_3_script_2.rects)  # -> Area, Centroid
custom_preview_2 = CustomPreview(Geometry=python_3_script_2.inactive, Material=ColourSwatch(SwatchColor=RGB(159, 171, 161)))
custom_preview_3 = CustomPreview(Geometry=python_3_script_2.done_surfaces, Material=ColourSwatch(SwatchColor=RGB(66, 71, 66)))
custom_preview_4 = CustomPreview(Geometry=python_3_script_2.active, Material=ColourSwatch(SwatchColor=RGB(56, 168, 54)))
text_tag = TextTag(Location=area.Centroid, Text=python_3_script_2.texts, Colour=ColourSwatch(SwatchColor=RGB(0, 0, 0)))

# ----
panel_4 = Panel(python_3_script_2.debug)
panel_5 = Panel(python_3_script_2.done_surfaces)
