# Grasshopper definition GH_voxel_generation-3_autosave.gh (Grasshopper 1.0.8)
# plug-ins: Heteroptera, VoxelTools, Human, Telepathy

# LOAD HEIGHTMAP FILE
# SELECT ONE EXISTING FILE
F = File("C:\Users\Bhavana\Documents\Hardware 3\z_CurrentTargetDesign\current_target.jpg")
# LOAD POINT CLOUD FILE
# SELECT ONE EXISTING FILE
F_2 = File("C:\Users\Bhavana\Documents\Hardware 3\z_Current Point cloud\current_pointcloud.ply")
P = Plane(PlaneXY(0, 0, 0))
read_file = ReadFile(File="C:\Users\Bhavana\Documents\Hardware 3\z_CurrentTargetDesign\current_target.jpg", PerLineParse=True)
# PARAMETERS
read_file_2 = ReadFile(File="C:\Users\Bhavana\Documents\Hardware 3\z_Current Heatmap_PNG\current_heatmap.png", PerLineParse=True)

clay_height = Slider(30, range=0..100)
voxel_density__mm = Slider(2.5, range=2.5..20)
num_voxel_density = RemoteSender(voxel_density__mm)
num_clay_height = RemoteSender(clay_height)

# ----
# CLAY BLOCK DIMENSIONS
panel = Panel("150")
rectangle = Rectangle(Plane=P, XSize=panel, YSize=panel, Radius=0)  # -> Rectangle, Length
srf = Surface(rectangle.Rectangle)

panel_2 = Panel("Physical Model")

# ----
# Export 2D HEAT MAP
py3 = Python3Script(trigger=read_file)  # -> status
# ---------- py3: Python ----------
import Rhino
import Rhino.Geometry as rg
import System.Drawing as sd
import socket, json, os, time

OUTPUT_PATH = r"C:\Users\Bhavana\Documents\Hardware 3\z_Target heatmap_Colour_PNG_Output\target_heatmap.png"

if trigger:  # viene del Read File
    os.makedirs(r"C:\Users\Bhavana\Documents\Hardware 3\z_Target heatmap_Colour_PNG_Output", exist_ok=True)
    
    view = Rhino.RhinoDoc.ActiveDoc.Views.Find("Top", False)
    if view is None:
        view = Rhino.RhinoDoc.ActiveDoc.Views.ActiveView

    bbox = rg.BoundingBox(rg.Point3d(0, 0, 0), rg.Point3d(150, 150, 0))
    view.ActiveViewport.ZoomBoundingBox(bbox)
    Rhino.RhinoDoc.ActiveDoc.Views.Redraw()
    time.sleep(0.5)

    bmp = view.CaptureToBitmap(sd.Size(500, 500))
    bmp.Save(OUTPUT_PATH)
    bmp.Dispose()

    sock = socket.socket(socket.AF_INET, socket.SOCK_DGRAM)
    sock.sendto(json.dumps({"type": "heightmap_update", "status": "OK"}).encode(), ("127.0.0.1", 6005))
    sock.close()
    
    status = "OK - " + time.strftime("%H:%M:%S")
else:
    status = "waiting..."
# ---------- end py3 ----------

# ----
# Export 2D PROGRESS
py3_2 = Python3Script(trigger=read_file_2)  # -> status
# ---------- py3_2: Python ----------
import Rhino
import Rhino.Geometry as rg
import System.Drawing as sd
import os
import time
import socket
import json

OUTPUT_PATH = r"C:\Users\Bhavana\Documents\Hardware 3\z_Target heatmap_Colour_PNG_Output\progress_heatmap.png"

if trigger:  # viene del Read File
    try:
        os.makedirs(r"C:\Users\Bhavana\Documents\Hardware 3\z_Target heatmap_Colour_PNG_Output", exist_ok=True)
        
        view = Rhino.RhinoDoc.ActiveDoc.Views.Find("Top", False)
        if view is None:
            view = Rhino.RhinoDoc.ActiveDoc.Views.ActiveView

        bbox = rg.BoundingBox(rg.Point3d(275, 0, 0), rg.Point3d(425, 150, 0))
        view.ActiveViewport.ZoomBoundingBox(bbox)
        Rhino.RhinoDoc.ActiveDoc.Views.Redraw()
        time.sleep(0.5)

        bmp = view.CaptureToBitmap(sd.Size(500, 500))
        bmp.Save(OUTPUT_PATH)
        bmp.Dispose()

        status = "OK - " + time.strftime("%H:%M:%S")

        payload = json.dumps({
            "type": "progress_update",
            "status": "OK"
        }).encode("utf-8")
        sock = socket.socket(socket.AF_INET, socket.SOCK_DGRAM)
        sock.sendto(payload, ("127.0.0.1", 6005))
        sock.close()

    except Exception as e:
        status = "Error: " + str(e)
else:
    status = "waiting..."
# ---------- end py3_2 ----------

# ----
# File that overwrites each loop
panel_3 = Panel("/.point_cloud")
# POINT CLOUD FROM CLAY BLOCK
panel_4 = Panel(".PCD")

# ----
# File saved as record history
panel_5 = Panel("/.point_cloud_history")

panel_6 = Panel(py3)
panel_7 = Panel(py3_2)

# ----
# USER FEEDBACK (VOXELIZED)
num_voxel_density_2 = RemoteReceiver(num_voxel_density)

num_voxel_density_3 = RemoteReceiver(num_voxel_density)

# ---- group: Resolution
# LARGER NUMBER MORE RESOLUTION
# BE CAREFUL!
dim = Dimensions(Surface=srf)  # -> UDimension, VDimension
number_slider = Slider(50, range=25..200)
division = Division(A=dim.VDimension, B=dim.UDimension)
multiplication = Multiplication(A=division, B=number_slider)

# ----
# File that overwrites each loop
panel_8 = Panel("/.height_map")
# HEIGHT MAP
# FROM AI GEOMETRY ENGINE
panel_9 = Panel(".PNG")

# ----
# File saved as record history
panel_10 = Panel("/.height_map_history")

crv = Curve(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)

# ---- group: 2D Heightmap Image
cluster = Cluster(C=rectangle.Rectangle)
geo = Geometry(cluster)

# ---- group: 3D Voxel Projection
cluster_2 = Cluster(C=crv)
geo_2 = Geometry(cluster_2)

# ----
area = Area(Geometry=crv)  # -> Area, Centroid
xy = XYPlane(Origin=area.Centroid)

# ----
# LOAD AND FIX THE POINT CLOUD
_3dm = Import3DM(File=F_2, Layer="*", Name="*")
pcloud = PointCloud(_3dm)
point_cloud = PointCloudAttributes(Cloud=pcloud)  # -> Cloud, Locations, Normals, Colours, Extra, Hidden
del = DelaunayMesh(Points=point_cloud.Locations, Plane=PlaneXY(0, 0, 0))
scale = Scale(Geometry=del, Center=Point(0, 0, 0), Factor="2000")  # -> Geometry, Transform
bbox = BoundingBox(Content=scale.Geometry, Plane=PlaneXY(0, 0, 0))  # -> Box, Box_2
box = EvaluateBox(Box=bbox.Box, UParameter=0.5, VParameter=0.5, WParameter="1")  # -> Plane, Point, Include
orient = Orient(Geometry=scale.Geometry, Source=box.Plane, Target=xy)  # -> Geometry, Transform
geo_mesh_from_point_cloud = RemoteSender(orient.Geometry)

# ----
# MESH TO VOXEL
geo_mesh_from_point_cloud_2 = RemoteReceiver(geo_mesh_from_point_cloud)
bbox_2 = BoundingBox(Content=geo_mesh_from_point_cloud_2, Plane=PlaneXY(0, 0, 0), UnionBox=True)  # -> Box, Box_2
voxcreate = CreateVoxelGrid(BoundingBox=bbox_2.Box, SizeX=num_voxel_density_2, SizeY=num_voxel_density_2, SizeZ=num_voxel_density_2)
voxgeo = VoxelateGeometry(Geometry=geo_mesh_from_point_cloud_2, VoxelGrid=voxcreate, Distance=expr("x/2", num_voxel_density_2))
voxbox = VoxelGridToBoxes(VoxelGrid=voxgeo, Selection="1")  # -> Boxes, Points
mesh = Mesh(voxbox.Boxes)

# ----
# COLOR MAP
# AS USER REFERENCE FOR SCULPTING
# USER FEEDBACK OF CURRENT PROGRESS
panel_11 = Panel("VOXEL RECONSTRUCTION ")
# DISPLAY TARGET
num_clay_height_2 = RemoteReceiver(num_clay_height)

# ----
# DISPLAY CURRENT PROGRESS
area_2 = Area(Geometry=mesh)  # -> Area, Centroid
pdecon = Deconstruct(Point=area_2.Centroid)  # -> XComponent, YComponent, ZComponent
extremes = MinMax(Number=pdecon.ZComponent)  # -> Minimum, Maximum
gradient = Gradient(
    LowerLimit=extremes.Minimum,
    UpperLimit=extremes.Maximum,
    Parameter=pdecon.ZComponent,
    stops=[0: RGB(0, 128, 0), 0.5: RGB(255, 255, 0), 1: RGB(255, 0, 0)])
previewmat = CustomPreviewMaterials(Geometry=mesh, DiffuseColor=gradient)

# ----
# TARGET IMAGE (VOXELIZED)
img = ImportImage(File=F, Rectangle=rectangle.Rectangle, XSamples=number_slider, YSamples=multiplication)
demesh = DeconstructMesh(Mesh=img)  # -> Vertices, Faces, Colours, Normals
ahsl = SplitAHSL(Colour=demesh.Colours)  # -> Alpha, Hue, Saturation, Luminance
panel_12 = Panel(ahsl.Luminance)
neg = Negative(Value=num_clay_height_2)
bnd = Bounds(Numbers=panel_12)
dom = ConstructDomain(DomainStart=0, DomainEnd=neg)
remap = RemapNumbers(Value=panel_12, Source=bnd, Target=dom)  # -> Mapped, Clipped
Z = UnitZ(Factor=remap.Mapped)
move = Move(Geometry=demesh.Vertices, Motion=Z)  # -> Geometry, Transform
conmesh = ConstructMesh(Vertices=move.Geometry, Faces=demesh.Faces)

msmooth = SmoothMesh(Mesh=conmesh, Strength=Slider(0.1, range=0..1), SkipNaked=True, Iterations=Slider(10, range=0..10))

geo_mesh_from_height_map = RemoteSender(msmooth)

# ----
# VOXELIZE TARGET TOPOGRAPHY
geo_mesh_from_height_map_2 = RemoteReceiver(geo_mesh_from_height_map)
bbox_3 = BoundingBox(Content=geo_mesh_from_height_map_2, Plane=PlaneXY(0, 0, 0), UnionBox=True)  # -> Box, Box_2
voxcreate_2 = CreateVoxelGrid(BoundingBox=bbox_3.Box, SizeX=num_voxel_density_3, SizeY=num_voxel_density_3, SizeZ=num_voxel_density_3)
voxgeo_2 = VoxelateGeometry(Geometry=geo_mesh_from_height_map_2, VoxelGrid=voxcreate_2, Distance=expr("x/2", num_voxel_density_3))
voxbox_2 = VoxelGridToBoxes(VoxelGrid=voxgeo_2, Selection="1")  # -> Boxes, Points
mesh_2 = Mesh(voxbox_2.Boxes)

area_3 = Area(Geometry=mesh_2)  # -> Area, Centroid
pdecon_2 = Deconstruct(Point=area_3.Centroid)  # -> XComponent, YComponent, ZComponent
extremes_2 = MinMax(Number=pdecon_2.ZComponent)  # -> Minimum, Maximum
gradient_2 = Gradient(
    LowerLimit=extremes_2.Minimum,
    UpperLimit=extremes_2.Maximum,
    Parameter=pdecon_2.ZComponent,
    stops=[0: RGB(0, 128, 0), 0.5: RGB(255, 255, 0), 1: RGB(255, 0, 0)])

previewmat_2 = CustomPreviewMaterials(Geometry=mesh_2, DiffuseColor=gradient_2)

# ==== cluster Cluster
C = ClusterInput()
disc = Discontinuity(Curve=C, Level=1)  # -> Points, Parameters
dot = AnnotationDot(Location=disc.Points, PrimaryText=disc.Points, TextHeight=Slider(10, range=0..10))  # -> AnnotationDot, Location, PrimaryText, TextHeight
ad = ClusterOutput(dot.AnnotationDot)
