# Grasshopper definition GH_voxel_generation-2.gh (Grasshopper 1.0.8)
# plug-ins: Heteroptera, VoxelTools, Human, Firefly_X, Telepathy

P = Plane(PlaneXY(0, 0, 0))

# ----
# PARAMETERS
clay_height = Slider(30, range=0..100)
voxel_density__mm = Slider(5, range=2.5..20)
# LOAD HEIGHTMAP FILE
# SELECT ONE EXISTING FILE
num_voxel_density = RemoteSender(voxel_density__mm)
num_clay_height = RemoteSender(clay_height)

# ----
# CLAY BLOCK DIMENSIONS
panel = Panel("150")
rectangle = Rectangle(Plane=P, XSize=panel, YSize=panel, Radius=0)  # -> Rectangle, Length
srf = Surface(rectangle.Rectangle)

# ----
# USER FEEDBACK (VOXELIZED)
# LOAD MESH FILE
# SELECT ONE EXISTING FILE
# LOAD POINT_CLOUD FILE FROM LOCAL DIRECTORY
F = File("C:\Users\amaro\Desktop\_mesh\last_mesh.obj")

trigger = Trigger(Interval=100, TimerInterval=100, Target=counter)  # disabled
dom = ConstructDomain(DomainStart=0, DomainEnd=1)
# MATERIAL TO REMOVE
relay = Relay()
counter = Counter(CountDirection=True, Step=Slider(0.01, range=0..0.01), StartStop=True, Reset=Button(), OptionalCounterDomain=dom)
lng = ListLength(List=relay)
multiplication = Multiplication(A=lng, B=counter)
rev = ReverseList(List=relay)
dom_2 = ConstructDomain(DomainStart=lng, DomainEnd=multiplication)
subset = SubList(List=rev, Domain=dom_2, Wrap=True)  # -> List, Index
cull_i = CullIndex(List=subset.List, Indices="0", Wrap=True)

panel_2 = Panel("Physical Model")
_3dm = Import3DM(File=F, Layer="*", Name="*")
num_voxel_density_2 = RemoteReceiver(num_voxel_density)
mesh = Mesh(_3dm)

# ----
# File that overwrites each loop
panel_3 = Panel("/.point_cloud")
# POINT CLOUD FROM CLAY BLOCK
panel_4 = Panel(".PCD")

# ----
# File saved as record history
panel_5 = Panel("/.point_cloud_history")

scale = Scale(Geometry=mesh, Center=Point(0, 0, 0), Factor="1000")  # -> Geometry, Transform
num_voxel_density_3 = RemoteReceiver(num_voxel_density)
bbox = BoundingBox(Content=scale.Geometry, Plane=PlaneXY(0, 0, 0))  # -> Box, Box_2

# ---- group: Resolution
# LARGER NUMBER MORE RESOLUTION
# BE CAREFUL!
dim = Dimensions(Surface=srf)  # -> UDimension, VDimension
number_slider = Slider(50, range=25..200)
division = Division(A=dim.VDimension, B=dim.UDimension)
multiplication_2 = Multiplication(A=division, B=number_slider)

# ----
# File that overwrites each loop
panel_6 = Panel("/.height_map")
# HEIGHT MAP
# FROM AI GEOMETRY ENGINE
panel_7 = Panel(".PNG")

# ----
# File saved as record history
panel_8 = Panel("/.height_map_history")

box = EvaluateBox(Box=bbox.Box, UParameter=0.5, VParameter=0.5, WParameter="0")  # -> Plane, Point, Include
crv = Curve(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)
area = Area(Geometry=crv)  # -> Area, Centroid

# ---- group: 2D Heightmap Image
cluster = Cluster(C=rectangle.Rectangle)
geo = Geometry(cluster)

# ---- group: 3D Voxel Projection
cluster_2 = Cluster(C=crv)
geo_2 = Geometry(cluster_2)

# ----
xy = XYPlane(Origin=area.Centroid)
orient = Orient(Geometry=scale.Geometry, Source=box.Plane, Target=xy)  # -> Geometry, Transform

# ----
# POINT CLOUD TO VOXEL
bbox_2 = BoundingBox(Content=orient.Geometry, Plane=PlaneXY(0, 0, 0), UnionBox=True)  # -> Box, Box_2
voxcreate = CreateVoxelGrid(BoundingBox=bbox_2.Box, SizeX=num_voxel_density_2, SizeY=num_voxel_density_2, SizeZ=num_voxel_density_2)
voxgeo = VoxelateGeometry(Geometry=orient.Geometry, VoxelGrid=voxcreate, Distance=expr("x/2", num_voxel_density_2))
voxbox = VoxelGridToBoxes(VoxelGrid=voxgeo, Selection="1")  # -> Boxes, Points
mesh_2 = Mesh(voxbox.Boxes)

# ----
# COLOR MAP
# AS USER REFERENCE FOR SCULPTING
# USER FEEDBACK OF CURRENT PROGRESS
panel_9 = Panel("VOXEL RECONSTRUCTION ")

# ----
# DISPLAY CURRENT PROGRESS
area_2 = Area(Geometry=mesh_2)  # -> Area, Centroid
pdecon = Deconstruct(Point=area_2.Centroid)  # -> XComponent, YComponent, ZComponent
extremes = MinMax(Number=pdecon.ZComponent)  # -> Minimum, Maximum
gradient = Gradient(
    LowerLimit=extremes.Minimum,
    UpperLimit=extremes.Maximum,
    Parameter=pdecon.ZComponent,
    stops=[0: RGB(48, 18, 59), 0.0294: RGB(56, 40, 112), 0.0588: RGB(63, 62, 156), 0.0882: RGB(68, 82, 193), 0.118: RGB(70, 102, 221), 0.147: RGB(71, 122, 241)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])
preview = CustomPreview(Geometry=mesh_2, Material=gradient)

# ----
# DISPLAY TARGET
num_clay_height_2 = RemoteReceiver(num_clay_height)

# ----
# Export 2D
toggle = BooleanToggle(True)
py3 = Python3Script(enabled=toggle)  # -> status
# ---------- py3: Python ----------
import Rhino
import Rhino.Geometry as rg
import System.Drawing as sd
import os
import time

OUTPUT_PATH = r"C:/Users/amaro/Desktop/_heightmap_color/heightmap.png"

status = "idle"

if enabled:
    try:
        os.makedirs(r"C:/Users/amaro/Desktop/_heightmap_color", exist_ok=True)
        
        view = Rhino.RhinoDoc.ActiveDoc.Views.Find("Top", False)
        if view is None:
            view = Rhino.RhinoDoc.ActiveDoc.Views.ActiveView

        # Zoom al bloque 0,0 - 150,150
        bbox = rg.BoundingBox(rg.Point3d(0, 0, 0), rg.Point3d(150, 150, 0))
        view.ActiveViewport.ZoomBoundingBox(bbox)
        
        Rhino.RhinoDoc.ActiveDoc.Views.Redraw()
        time.sleep(0.5)
        
        bmp = view.CaptureToBitmap(sd.Size(500, 500))
        bmp.Save(OUTPUT_PATH)
        bmp.Dispose()
        
        status = "OK"
    except Exception as e:
        status = "Error: " + str(e)
else:
    status = "disabled"
# ---------- end py3 ----------

# ----
# TARGET IMAGE (VOXELIZED)
F_2 = File("C:\Users\amaro\Desktop\_heightmap\current_hm.jpeg")
img = ImportImage(File=F_2, Rectangle=rectangle.Rectangle, XSamples=number_slider, YSamples=multiplication_2)
demesh = DeconstructMesh(Mesh=img)  # -> Vertices, Faces, Colours, Normals
ahsl = SplitAHSL(Colour=demesh.Colours)  # -> Alpha, Hue, Saturation, Luminance
panel_10 = Panel(ahsl.Luminance)
neg = Negative(Value=num_clay_height_2)
bnd = Bounds(Numbers=panel_10)
dom_3 = ConstructDomain(DomainStart=0, DomainEnd=neg)
remap = RemapNumbers(Value=panel_10, Source=bnd, Target=dom_3)  # -> Mapped, Clipped
Z = UnitZ(Factor=remap.Mapped)
move = Move(Geometry=demesh.Vertices, Motion=Z)  # -> Geometry, Transform
conmesh = ConstructMesh(Vertices=move.Geometry, Faces=demesh.Faces)

msmooth = SmoothMesh(Mesh=conmesh, Strength=Slider(0.2, range=0..1), SkipNaked=True, Iterations=Slider(10, range=0..10))

geo_mesh_from_height_map = RemoteSender(msmooth)

# ----
# VOXELIZE TARGET TOPOGRAPHY
geo_mesh_from_height_map_2 = RemoteReceiver(geo_mesh_from_height_map)
bbox_3 = BoundingBox(Content=geo_mesh_from_height_map_2, Plane=PlaneXY(0, 0, 0), UnionBox=True)  # -> Box, Box_2
voxcreate_2 = CreateVoxelGrid(BoundingBox=bbox_3.Box, SizeX=num_voxel_density_3, SizeY=num_voxel_density_3, SizeZ=num_voxel_density_3)
voxgeo_2 = VoxelateGeometry(Geometry=geo_mesh_from_height_map_2, VoxelGrid=voxcreate_2, Distance=expr("x/2", num_voxel_density_3))
voxbox_2 = VoxelGridToBoxes(VoxelGrid=voxgeo_2, Selection="1")  # -> Boxes, Points
mesh_3 = Mesh(voxbox_2.Boxes)

area_3 = Area(Geometry=mesh_3)  # -> Area, Centroid
pdecon_2 = Deconstruct(Point=area_3.Centroid)  # -> XComponent, YComponent, ZComponent
extremes_2 = MinMax(Number=pdecon_2.ZComponent)  # -> Minimum, Maximum
gradient_2 = Gradient(
    LowerLimit=extremes_2.Minimum,
    UpperLimit=extremes_2.Maximum,
    Parameter=pdecon_2.ZComponent,
    stops=[0: RGB(0, 128, 0), 0.5: RGB(255, 255, 0), 1: RGB(255, 0, 0)])

previewmat = CustomPreviewMaterials(Geometry=mesh_3, DiffuseColor=gradient_2)

# ==== cluster Cluster
C = ClusterInput()
disc = Discontinuity(Curve=C, Level=1)  # -> Points, Parameters
dot = AnnotationDot(Location=disc.Points, PrimaryText=disc.Points, TextHeight=Slider(10, range=0..10))  # -> AnnotationDot, Location, PrimaryText, TextHeight
ad = ClusterOutput(dot.AnnotationDot)
